% Requirement links of AHRS_Voter.slx (R2024b)

block :111 implements HighLevelReqs.slreqx#17: HighLevelReqs_13: AHRS Usage of Single Sensor
block :140 implements HighLevelReqs.slreqx#13: HighLevelReqs_9: AHRS Validity Check
block :141 implements HighLevelReqs.slreqx#13: HighLevelReqs_9: AHRS Validity Check
block :142 implements HighLevelReqs.slreqx#13: HighLevelReqs_9: AHRS Validity Check
block :143 implements HighLevelReqs.slreqx#15: HighLevelReqs_11: AHRS Voting for Triple Sensors
block :143 implements HighLevelReqs.slreqx#16: HighLevelReqs_12: AHRS Voting for Dual Sensors
block :143 implements HighLevelReqs.slreqx#17: HighLevelReqs_13: AHRS Usage of Single Sensor
block :144 implements HighLevelReqs.slreqx#15: HighLevelReqs_11: AHRS Voting for Triple Sensors
block :144 implements HighLevelReqs.slreqx#16: HighLevelReqs_12: AHRS Voting for Dual Sensors
block :144 implements HighLevelReqs.slreqx#17: HighLevelReqs_13: AHRS Usage of Single Sensor
block :147 implements HighLevelReqs.slreqx#15: HighLevelReqs_11: AHRS Voting for Triple Sensors
block :147 implements HighLevelReqs.slreqx#16: HighLevelReqs_12: AHRS Voting for Dual Sensors
block :147 implements HighLevelReqs.slreqx#17: HighLevelReqs_13: AHRS Usage of Single Sensor
block :148 implements HighLevelReqs.slreqx#15: HighLevelReqs_11: AHRS Voting for Triple Sensors
block :148 implements HighLevelReqs.slreqx#16: HighLevelReqs_12: AHRS Voting for Dual Sensors
block :148 implements HighLevelReqs.slreqx#17: HighLevelReqs_13: AHRS Usage of Single Sensor
block :149 implements HighLevelReqs.slreqx#15: HighLevelReqs_11: AHRS Voting for Triple Sensors
block :149 implements HighLevelReqs.slreqx#16: HighLevelReqs_12: AHRS Voting for Dual Sensors
block :149 implements HighLevelReqs.slreqx#17: HighLevelReqs_13: AHRS Usage of Single Sensor
block :150 implements HighLevelReqs.slreqx#15: HighLevelReqs_11: AHRS Voting for Triple Sensors
block :150 implements HighLevelReqs.slreqx#16: HighLevelReqs_12: AHRS Voting for Dual Sensors
block :150 implements HighLevelReqs.slreqx#17: HighLevelReqs_13: AHRS Usage of Single Sensor
block :151 implements HighLevelReqs.slreqx#15: HighLevelReqs_11: AHRS Voting for Triple Sensors
block :151 implements HighLevelReqs.slreqx#16: HighLevelReqs_12: AHRS Voting for Dual Sensors
block :151 implements HighLevelReqs.slreqx#17: HighLevelReqs_13: AHRS Usage of Single Sensor
block :151 implements HighLevelReqs.slreqx#18: HighLevelReqs_14: AHRS Usage of No Sensor
block :155 implements HighLevelReqs.slreqx#18: HighLevelReqs_14: AHRS Usage of No Sensor
block :169 implements HighLevelReqs.slreqx#15: HighLevelReqs_11: AHRS Voting for Triple Sensors
block :169 implements HighLevelReqs.slreqx#16: HighLevelReqs_12: AHRS Voting for Dual Sensors
block :169 implements HighLevelReqs.slreqx#17: HighLevelReqs_13: AHRS Usage of Single Sensor
block :169 implements HighLevelReqs.slreqx#18: HighLevelReqs_14: AHRS Usage of No Sensor
block :170 implements HighLevelReqs.slreqx#13: HighLevelReqs_9: AHRS Validity Check
block :171 implements HighLevelReqs.slreqx#13: HighLevelReqs_9: AHRS Validity Check
block :172 implements HighLevelReqs.slreqx#13: HighLevelReqs_9: AHRS Validity Check
block :174 implements HighLevelReqs.slreqx#15: HighLevelReqs_11: AHRS Voting for Triple Sensors
block :174 implements HighLevelReqs.slreqx#16: HighLevelReqs_12: AHRS Voting for Dual Sensors
block :174 implements HighLevelReqs.slreqx#17: HighLevelReqs_13: AHRS Usage of Single Sensor
block :174 implements HighLevelReqs.slreqx#18: HighLevelReqs_14: AHRS Usage of No Sensor
block :25 implements HighLevelReqs.slreqx#16: HighLevelReqs_12: AHRS Voting for Dual Sensors
block :40 implements HighLevelReqs.slreqx#15: HighLevelReqs_11: AHRS Voting for Triple Sensors
block :63 implements HighLevelReqs.slreqx#13: HighLevelReqs_9: AHRS Validity Check